# Grasshopper definition integration-automation.gh (Grasshopper 1.0.8)

mesh = Mesh(<mesh referenced from the Rhino model>)
area = Area(Geometry=mesh)  # -> Area, Centroid
Z = UnitZ(Factor=1)
pl = PlaneNormal(Origin=area.Centroid, ZAxis=Z)
scale = Scale(Geometry=mesh, Center=area.Centroid, Factor=Slider(37, range=0..100))  # -> Geometry, Transform
rad = Radians(Degrees=Slider(363, range=0..1000))
rotate = Rotate(Geometry=scale.Geometry, Angle=rad, Plane=pl)  # -> Geometry, Transform
Y = UnitY(Factor=Slider(20, range=0..100))
Z_2 = UnitZ(Factor=Slider(9, range=0..100))
X = UnitX(Factor=Slider(8, range=0..10))
move = Move(Geometry=rotate.Geometry, Motion=Y)  # -> Geometry, Transform
move_2 = Move(Geometry=move.Geometry, Motion=X)  # -> Geometry, Transform

panel = Panel("https://climate.onebuilding.org/WMO_Region_6_Europe/GBR_United_Kingdom/ENG_England/GBR_ENG_London.Wea.Ctr-St.James.Park.037700_TMYx.zip")
number_slider = Slider(9, range=1..12)
number_slider_2 = Slider(15, range=0..23)
number_slider_3 = Slider(20, range=1..31)
downloadepw = LBDownloadWeather(weather_URL=panel)  # -> epw_file, stat_file, ddy_file; plug-in component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
open_weather_file = Ladybug_OpenEPWWeatherFile(open=Toggle(False))  # -> epwFile; plug-in component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
epwmap = LBEPWmap(epw_map=Toggle(False))  # -> report; plug-in component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
analysisperiod = LBAnalysisPeriod(
    start_month=number_slider,
    start_day=number_slider_3,
    start_hour=number_slider_2,
    end_month=number_slider,
    end_day=number_slider_3,
    end_hour=number_slider_2)  # -> period, hoys, dates; plug-in component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
importepw = LBImportEPW(epw_file=downloadepw.epw_file)  # -> location, dry_bulb_temperature, dew_point_temperature, relative_humidity, wind_speed, wind_direction, direct_normal_rad, diffuse_horizontal_rad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; plug-in component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

move_3 = Move(Geometry=move_2.Geometry, Motion=Z_2)  # -> Geometry, Transform
mesh_2 = Mesh([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])
brep = Brep(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)

genpts = LBGeneratePointGrid(geometry=brep, grid_size=Slider(8, range=0..100000))  # -> points, vectors, face_areas, graft(mesh); plug-in component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
applyper = LBApplyAnalysisPeriod(data=importepw.dry_bulb_temperature, period=analysisperiod.period)  # -> data; plug-in component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
humantosky = LBHumanToSkyRelation(
    location=importepw.location,
    position=flatten(genpts.points),
    context=flatten([mesh_2, move_3.Geometry]),
    run=Toggle(False))  # -> report, human_points, human_line, fract_body_exp, sky_exposure; plug-in component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
applyper_2 = LBApplyAnalysisPeriod(data=importepw.relative_humidity, period=analysisperiod.period)  # -> data; plug-in component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
applyper_3 = LBApplyAnalysisPeriod(data=importepw.wind_speed, period=analysisperiod.period)  # -> data; plug-in component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
applyper_4 = LBApplyAnalysisPeriod(data=importepw.dry_bulb_temperature, period=analysisperiod.period)  # -> data; plug-in component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
applyper_5 = LBApplyAnalysisPeriod(data=importepw.direct_normal_rad, period=analysisperiod.period)  # -> data; plug-in component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
applyper_6 = LBApplyAnalysisPeriod(data=importepw.diffuse_horizontal_rad, period=analysisperiod.period)  # -> data; plug-in component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
applyper_7 = LBApplyAnalysisPeriod(data=importepw.horizontal_infrared_rad, period=analysisperiod.period)  # -> data; plug-in component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
applyper_8 = LBApplyAnalysisPeriod(data=humantosky.fract_body_exp, period=analysisperiod.period)  # -> data; plug-in component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
xdata = LBDeconstructData(data=applyper_8)  # -> header, flatten(values); plug-in component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
outdoorsolarmrt = LBOutdoorSolarMRT(
    location=importepw.location,
    surface_temp=applyper_4,
    dir_norm_rad=applyper_5,
    diff_horiz_rad=applyper_6,
    horiz_infrared=applyper_7,
    fract_body_exp=xdata.values,
    sky_exposure=humantosky.sky_exposure,
    run=Toggle(True))  # -> report, short_erf, long_erf, short_dmrt, long_dmrt, mrt; plug-in component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
utci = LBUTCIComfort(air_temp=applyper, mrt=outdoorsolarmrt.mrt, rel_humid=applyper_2, wind_vel=applyper_3, run=Toggle(True))  # -> report, utci, comfort, condition, category, comf_obj; plug-in component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
xdata_2 = LBDeconstructData(data=utci.utci)  # -> header, flatten(values); plug-in component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

heatmap = LBSpatialHeatmap(values=xdata_2.values, mesh=genpts.mesh)  # -> mesh, legend, title, colors, legend_par; plug-in component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
createlegend = LBCreateLegend(values=xdata_2.values, title="UTCI", legend_par=heatmap.legend_par)  # -> mesh, title_obj, label_objs, label_text, colors; plug-in component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

custom_preview = CustomPreview(
    Geometry=[createlegend.mesh, createlegend.title_obj, createlegend.label_objs, heatmap.mesh],
    Material={diffuse=RGB(221, 160, 221), emission=RGB(66, 48, 66), shine=0.5, specular=RGB(255, 255, 255), transparency=0})

ghpython_script = GhPythonScript(trigger=Toggle(False))  # -> out, capture; inputs trigger: Boolean
# ---------- ghpython_script: Python ----------
__author__ = "Lenovo"
__version__ = "2025.11.29"

import scriptcontext as sc
import Rhino

# 上一帧 trigger，用于检测 False→True 上升沿
if "prev_trigger" not in sc.sticky:
    sc.sticky["prev_trigger"] = False

prev = sc.sticky["prev_trigger"]
capture = False

if trigger and not prev:
    # 使用 Rhino 文档（建筑、地面都在这里）
    rhdoc = Rhino.RhinoDoc.ActiveDoc

    # ① 找到 Top 视图，并在这个视图上 ZoomExtents
    top_view = rhdoc.Views.Find("Top", False)
    if top_view:
        vp = top_view.ActiveViewport
        vp.ZoomExtents()
        rhdoc.Views.Redraw()

    # ② 隐藏所有 Rhino 实体（不用判断 IsVisible，统统 Hide）
    for obj in list(rhdoc.Objects):
        rhdoc.Objects.Hide(obj, True)

    rhdoc.Views.Redraw()

    # ③ 本帧触发截图
    capture = True

# 记录当前 trigger 状态
sc.sticky["prev_trigger"] = trigger

out = "trigger: {}  prev: {}  capture: {}".format(trigger, prev, capture)
# ---------- end ghpython_script ----------
captureview = LBCaptureView(
    file_name="0.1",
    folder="D:\UCL\Studio File\sd_v1.5_with_LoRA\bytedance\utci_pics",
    viewport="Top",
    width="3840",
    height="2160",
    capture=ghpython_script.capture)  # -> Output; plug-in component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
