# Grasshopper definition solar-wind-utci.ghx (Grasshopper 1.0.8)
# plug-ins: Bifocals

panel = Panel("https://climate.onebuilding.org/WMO_Region_6_Europe/GBR_United_Kingdom/ENG_England/GBR_ENG_London.Wea.Ctr-St.James.Park.037700_TMYx.zip")

# ---- group: 计算时间点
number_slider = Slider(15, range=0..23)
number_slider_2 = Slider(9, range=1..12)
number_slider_3 = Slider(20, range=1..31)
analysisperiod = LBAnalysisPeriod(
    start_month=number_slider_2,
    start_day=number_slider_3,
    start_hour=number_slider,
    end_month=number_slider_2,
    end_day=number_slider_3,
    end_hour=number_slider)  # -> period, hoys, dates; plug-in component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

# ---- group: 某个点全年UTCI分析
open_weather_file = Ladybug_OpenEPWWeatherFile(open=Toggle(True))  # -> epwFile; plug-in component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
importepw = LBImportEPW(epw_file=open_weather_file)  # -> location, dry_bulb_temperature, dew_point_temperature, relative_humidity, wind_speed, wind_direction, direct_normal_rad, diffuse_horizontal_rad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; plug-in component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
point = Point(<point referenced from the Rhino model>)
geometry = Geometry([<brep referenced from the Rhino model> x4])
humantosky = LBHumanToSkyRelation(location=importepw.location, position=flatten(point), context=flatten(geometry), run=Toggle(True))  # -> out, human_points, human_line, fract_body_exp, sky_exposure; plug-in component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
outdoorsolarmrt = LBOutdoorSolarMRT(
    location=importepw.location,
    surface_temp=importepw.dry_bulb_temperature,
    dir_norm_rad=importepw.direct_normal_rad,
    diff_horiz_rad=importepw.diffuse_horizontal_rad,
    horiz_infrared=importepw.horizontal_infrared_rad,
    sky_exposure=humantosky.sky_exposure,
    run=Toggle(True))  # -> out, short_erf, long_erf, short_dmrt, long_dmrt, mrt; plug-in component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
utci = LBUTCIComfort(
    air_temp=importepw.dry_bulb_temperature,
    mrt=outdoorsolarmrt.mrt,
    rel_humid=importepw.relative_humidity,
    wind_vel=importepw.wind_speed,
    run=Toggle(True))  # -> out, utci, comfort, condition, category, comf_obj; plug-in component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
hourlyplot = LBHourlyPlot(data=utci.utci)  # -> out, mesh, legend, borders, labels, title, vis_set; plug-in component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

# ----
panel_2 = Panel("https://climate.onebuilding.org/WMO_Region_6_Europe/GBR_United_Kingdom/ENG_England/GBR_ENG_London.Wea.Ctr-St.James.Park.037700_TMYx.zip")
epwmap = LBEPWmap(epw_map=Toggle(True))  # -> report; plug-in component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
panel_3 = Panel("https://climate.onebuilding.org/WMO_Region_6_Europe/GBR_United_Kingdom/ENG_England/GBR_ENG_London.Wea.Ctr-St.James.Park.037700_TMYx.zip")
epwmap_2 = LBEPWmap(epw_map=Toggle(False))  # -> report; plug-in component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
open_weather_file_2 = Ladybug_OpenEPWWeatherFile(open=Toggle(False))  # -> epwFile; plug-in component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
downloadepw = LBDownloadWeather(weather_URL=panel_3)  # -> epw_file, stat_file, ddy_file; plug-in component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

# ---- group: 具体时间点UTCI运算程序 / 地面brep or mesh
brep = Brep(<brep referenced from the Rhino model>)

# ----
panel_4 = Panel("sunshine-->radiation(辐射)-->thermal comfort")
importepw_2 = LBImportEPW(epw_file=downloadepw.epw_file)  # -> location, dry_bulb_temperature, dew_point_temperature, relative_humidity, wind_speed, wind_direction, direct_normal_rad, diffuse_horizontal_rad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; plug-in component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

# ---- group: 具体时间点UTCI运算程序 / 建筑等遮挡物brep or mesh
brep_2 = Brep([<brep referenced from the Rhino model> x4])

# ----
# human body<--->sky
# 
# context shading around the human subject
mesh = Mesh([<mesh referenced from the Rhino model> x86])
mesh_2 = Mesh([<mesh referenced from the Rhino model> x86])
legendpar = LBLegendParameters()  # -> leg_par; plug-in component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

# ---- group: 具体时间点UTCI运算程序
downloadepw_2 = LBDownloadWeather(weather_URL=panel_2)  # -> epw_file, stat_file, ddy_file; plug-in component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
importepw_3 = LBImportEPW(epw_file=downloadepw_2.epw_file)  # -> location, dry_bulb_temperature, dew_point_temperature, relative_humidity, wind_speed, wind_direction, direct_normal_rad, diffuse_horizontal_rad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; plug-in component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
genpts = LBGeneratePointGrid(geometry=brep, grid_size=Slider(8, range=0..100000))  # -> points, vectors, face_areas, graft(mesh); plug-in component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
humantosky_2 = LBHumanToSkyRelation(location=importepw_3.location, position=flatten(genpts.points), context=flatten(mesh), run=Toggle(False))  # -> report, human_points, human_line, fract_body_exp, sky_exposure; plug-in component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
applyper = LBApplyAnalysisPeriod(data=importepw_3.dry_bulb_temperature, period=analysisperiod.period)  # -> data; plug-in component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
applyper_2 = LBApplyAnalysisPeriod(data=importepw_3.relative_humidity, period=analysisperiod.period)  # -> data; plug-in component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
applyper_3 = LBApplyAnalysisPeriod(data=importepw_3.wind_speed, period=analysisperiod.period)  # -> data; plug-in component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
applyper_4 = LBApplyAnalysisPeriod(data=importepw_3.dry_bulb_temperature, period=analysisperiod.period)  # -> data; plug-in component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
applyper_5 = LBApplyAnalysisPeriod(data=importepw_3.direct_normal_rad, period=analysisperiod.period)  # -> data; plug-in component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
applyper_6 = LBApplyAnalysisPeriod(data=importepw_3.diffuse_horizontal_rad, period=analysisperiod.period)  # -> data; plug-in component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
applyper_7 = LBApplyAnalysisPeriod(data=importepw_3.horizontal_infrared_rad, period=analysisperiod.period)  # -> data; plug-in component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
applyper_8 = LBApplyAnalysisPeriod(data=humantosky_2.fract_body_exp, period=analysisperiod.period)  # -> data; plug-in component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
# MRT: mean radiant temperature
# 
# 平均辐射温度
xdata = LBDeconstructData(data=applyper_8)  # -> header, flatten(values); plug-in component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
outdoorsolarmrt_2 = LBOutdoorSolarMRT(
    location=importepw_3.location,
    surface_temp=applyper_4,
    dir_norm_rad=applyper_5,
    diff_horiz_rad=applyper_6,
    horiz_infrared=applyper_7,
    fract_body_exp=xdata.values,
    sky_exposure=humantosky_2.sky_exposure,
    run=Toggle(False))  # -> report, short_erf, long_erf, short_dmrt, long_dmrt, mrt; plug-in component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
utci_2 = LBUTCIComfort(air_temp=applyper, mrt=outdoorsolarmrt_2.mrt, rel_humid=applyper_2, wind_vel=applyper_3, run=Toggle(False))  # -> report, utci, comfort, condition, category, comf_obj; plug-in component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
xdata_2 = LBDeconstructData(data=utci_2.utci)  # -> header, flatten(values); plug-in component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
heatmap = LBSpatialHeatmap(values=xdata_2.values, mesh=genpts.mesh, legend_par=legendpar, legend_title="UTCI")  # -> mesh, legend, title, colors, legend_par; plug-in component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

# ----
brep_3 = Brep(<brep referenced from the Rhino model>)

# ----
# anchor point in the wind tunnel
point_2 = Point(<point referenced from the Rhino model>)

# ---- group: 做动画用
controldict = Butterfly_controlDict(start_time=0, end_time="400", write_interval=Slider(2, range=0..10), write_compression=Toggle(True), purge_write=0)  # -> control_dict; plug-in component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
solutionparams = Butterfly_SolutionParameters(control_dict=controldict)  # -> solution_par; plug-in component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

# ----
mesh_3 = Mesh([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])

mesh_4 = Mesh()
area = Area(Geometry=mesh_4)  # -> Area, Centroid
Z = UnitZ(Factor=1)
scale = Scale(Geometry=mesh_4, Center=area.Centroid, Factor=Slider(37, range=0..100))  # -> Geometry, Transform
pl = PlaneNormal(Origin=area.Centroid, ZAxis=Z)
rad = Radians(Degrees=Slider(326, range=0..1000))
rotate = Rotate(Geometry=scale.Geometry, Angle=rad, Plane=pl)  # -> Geometry, Transform
Y = UnitY(Factor=Slider(14, range=0..100))
X = UnitX(Factor=Slider(7, range=0..10))
move = Move(Geometry=rotate.Geometry, Motion=Y)  # -> Geometry, Transform
move_2 = Move(Geometry=move.Geometry, Motion=X)  # -> Geometry, Transform
Z_2 = UnitZ(Factor=Slider(10.7, range=0..100))
move_3 = Move(Geometry=move_2.Geometry, Motion=Z_2)  # -> Geometry, Transform

xdata_3 = LBDeconstructData(data=outdoorsolarmrt_2.mrt)  # -> header, flatten(values); plug-in component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
panel_5 = Panel("https://climate.onebuilding.org/WMO_Region_6_Europe/GBR_United_Kingdom/ENG_England/GBR_ENG_London.Wea.Ctr-St.James.Park.037700_TMYx.2004-2018.zip")
number_slider_4 = Slider(9, range=0..10)
number_slider_5 = Slider(1, range=0..10)
number_slider_6 = Slider(20, range=0..30)
number_slider_7 = Slider(15, range=0..100)
epwmap_3 = LBEPWmap(epw_map=Toggle(True))  # -> report; plug-in component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
downloadepw_3 = LBDownloadWeather(weather_URL=panel_5)  # -> epw_file, stat_file, ddy_file; plug-in component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
analysisperiod_2 = LBAnalysisPeriod(start_month=number_slider_4, start_day=number_slider_6, start_hour=0, end_month=number_slider_4, end_day=number_slider_6)  # -> period, hoys, dates; plug-in component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
importepw_4 = LBImportEPW(epw_file=downloadepw_3.epw_file)  # -> location, dry_bulb_temperature, dew_point_temperature, relative_humidity, wind_speed, wind_direction, direct_normal_rad, diffuse_horizontal_rad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; plug-in component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
sunpath = LBSunPath(
    location=importepw_4.location,
    hoys=analysisperiod_2.hoys,
    scale=Slider(1.7, range=0..10),
    data=importepw_4.dry_bulb_temperature)  # -> report, vectors, altitudes, azimuths, hoys, sun_pts, analemma, daily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; plug-in component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
brep_4 = Brep(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)
directsunhours = LBDirectSunHours(
    vectors=flatten(sunpath.vectors),
    geometry=flatten([brep_4, move_3.Geometry, mesh_3]),
    context=flatten([brep_4, move_3.Geometry, mesh_3]),
    grid_size=Slider(3, range=0..10),
    run=Toggle(True))  # -> report, points, results, mesh, legend, title, int_mtx; plug-in component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
edges = BrepEdges()  # -> Naked, Interior, NonManifold

legendpar_2 = LBLegendParameters()  # -> leg_par; plug-in component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
panel_6 = Panel("""MRT
（sunshine）""")
heatmap_2 = LBSpatialHeatmap(values=xdata_3.values, mesh=genpts.mesh, legend_par=legendpar_2, legend_title=panel_6)  # -> mesh, legend, title, colors, legend_par; plug-in component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

# ----
# wind rose
# data filtering
number_slider_8 = Slider(3, range=0..10)
number_slider_9 = Slider(50, range=0..100)
file_path = FilePath("C:\Users\11705\Desktop\SAU_RI_Riyadh.AB.404380_TMYx.2004-2018(1).epw")
downloadepw_4 = LBDownloadWeather(weather_URL=panel)  # -> epw_file, stat_file, ddy_file; plug-in component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
rectangular = Rectangular(
    Plane=PlaneXY(0, 0, 0),
    SizeX=number_slider_9,
    SizeY=number_slider_9,
    ExtentX=number_slider_8,
    ExtentY=Slider(2, range=0..10))  # -> Cells, Points
epwmap_4 = LBEPWmap(epw_map=Toggle(True))  # -> Output; plug-in component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
series = Series(Start="1", Step="1", Count="12")
flip_matrix = FlipMatrix(Data=reverse(rectangular.Points))
importepw_5 = LBImportEPW(epw_file=downloadepw_4.epw_file)  # -> location, dry_bulb_temperature, dew_point_temperature, relative_humidity, wind_speed, wind_direction, direct_normal_rad, diffuse_horizontal_rad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; plug-in component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
analysisperiod_3 = LBAnalysisPeriod(start_month=series, start_day=1, start_hour=0, end_month=series)  # -> period, hoys, dates; plug-in component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
flatten_tree = FlattenTree(Tree=flip_matrix, Path="{0}")
频率线距离 = Panel("10")
频率线时间 = Panel("120")
最大频率线 = Panel("7")
方向数量 = Panel("16")
windrose = LBWindRose(
    data=importepw_3.wind_speed,
    wind_direction=importepw_3.wind_direction,
    dir_count=方向数量,
    show_calm=Toggle(False),
    show_avg=Toggle(True),
    freq_dist=频率线距离,
    freq_hours=频率线时间,
    max_freq_lines=最大频率线)  # -> out, mesh, compass, orient_line, freq_line, windrose_line, legend, title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; plug-in component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
xmatrix = LBDeconstructMatrix(matrix=flatten(windrose.histogram))  # -> values; plug-in component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
panel_7 = Panel(windrose.prevailing)
param_viewer = ParamViewer(xmatrix)
explode_tree = ExplodeTree(Data=xmatrix)  # -> Branch0, Branch1, Branch2, Branch3, Branch4, Branch5, Branch6, Branch7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
# brep--->geo
average = Average(Input=explode_tree.Branch10)
panel_8 = Panel(average)
unit_y = UnitY(Factor=1)
unit_z = UnitZ(Factor=1)
subtraction = Subtraction(A=windrose.prevailing, B=Slider(360, range=0..1000))
rotate_2 = Rotate(Vector=unit_y, Axis=unit_z, Angle=subtraction)
wall = Butterfly_WallBoundary()  # -> wall_boundary; plug-in component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
reverse = Reverse(Vector=rotate_2)
windvector = Butterfly_WindVector(wind_speed=panel_8, wind_direction=reverse)  # -> wind_vector; plug-in component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
point_3 = Point(Point(0.02613810955, 0.1007759928, 0))
createbfgeometry = Butterfly_CreateButterflyGeometry(name="tiliang2", geo=flatten(mesh_2), boundary=wall, refine_levels="(2,4)")  # -> out, BF_geo; plug-in component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
tunnelparams = Butterfly_WindTunnelParameters(
    windward_x=Slider(3, range=0..10),
    top_x=Slider(2, range=0..10),
    sides_x=Slider(2, range=0..10),
    leeward_x=Slider(4, range=0..10))  # -> out, tunnel_params; plug-in component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
vector_display_ex = VectorDisplayEx(Point=point_3, Vector=reverse, Colour=RGB(0, 0, 0), Width=Slider(7, range=0..100))
地形类型 = Panel("4")
测量高度 = Panel("14")
number_slider_10 = Slider(1, range=0..1)
number_slider_11 = Slider(0.1, range=0..0.1)
createcasefromtunnel = Butterfly_CreateCaseFromTunnel(
    name="moni5324455",
    BF_geo=flatten(createbfgeometry.BF_geo),
    wind_vector=windvector,
    ref_wind_height=测量高度,
    landscape=地形类型,
    tunnel_params=tunnelparams.tunnel_params,
    run=Toggle(False))  # -> out, block_pts, 风洞设置, case; plug-in component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
construct_point = ConstructPoint(XCoordinate=Slider(60, range=0..100), YCoordinate=Slider(120, range=0..200), ZCoordinate=Slider(36, range=0..100))
wtgrading = Butterfly_windTunnelGrading(
    wind_tunnel=createcasefromtunnel.风洞设置,
    cell_size=Slider(0.2, range=0..1),
    cell_to_cell_ratio=1.2,
    wake_offset=2,
    height_offset=5)  # -> out, grad_xyz, cell_count_xyz, cell_count_tot, preview; plug-in component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
blockmesh = Butterfly_blockMesh(case=createcasefromtunnel.case, cell_count=construct_point, overwrite=True, write=Toggle(True), run=Toggle(False))  # -> out, case; plug-in component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
# surface for showing
# in the wind tunnel
显示风速箭头密度_越小越密集 = Slider(1, range=0..1)
snappyhexmeshdict = Butterfly_snappyHexMeshDict(
    castellated_mesh=True,
    snap=True,
    add_layers=False,
    n_cells_btwn_levels=3,
    max_global_cells=2000000,
    expansion_ratio=1.1,
    final_layer_thickness=0.7,
    min_thickness=0.1,
    n_layer_iter=50,
    additional_par="CastellatedMeshControl{ResovleFeatureAngle 78;}")  # -> snappy_hex_mesh_dict; plug-in component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
decomposepardict_scotch = Butterfly_decomposeParDictScotch(num_of_cpus="6")  # -> decompose_par_dict; plug-in component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
boolean_toggle = BooleanToggle(False)
gentestpts = Honeybee_GenerateTestPoints(testGeometry=brep_3, gridSize=显示风速箭头密度_越小越密集, distBaseSrf=Slider(0.1, range=0..1), moveTestMesh=Toggle(False))  # -> out, simplify(testPoints), simplify(ptsVectors), simplify(facesArea), simplify(mesh); plug-in component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
snappyhexmesh = Butterfly_snappyHexMesh(
    case=blockmesh.case,
    location_in_mesh=point_2,
    snappy_hex_mesh_dict=snappyhexmeshdict,
    decompose_par_dict=decomposepardict_scotch,
    write=boolean_toggle,
    run=boolean_toggle)  # -> out, case; plug-in component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
number_slider_12 = Slider(40, range=0..100)
ras = Butterfly_RASTurbulenceModel(RAS_model="RNGkEpsilon", turbulence=True, print_coeffs=True)  # -> RAS; plug-in component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
controldict_2 = Butterfly_controlDict(
    start_time=0,
    end_time=Slider(300, range=0..1000),
    write_interval=number_slider_12,
    write_compression=Toggle(True),
    purge_write=0)  # -> control_dict; plug-in component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
probes = Butterfly_probes(points=gentestpts.testPoints, write_interval=number_slider_12)  # -> probes; plug-in component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
decomposepardict_scotch_2 = Butterfly_decomposeParDictScotch(num_of_cpus="6")  # -> decompose_par_dict; plug-in component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
steadyincomp = Butterfly_SteadyIncompressibleRecipe(turbulence_prop=ras)  # -> out, recipe; plug-in component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
solutionparams_2 = Butterfly_SolutionParameters(control_dict=controldict_2, probes=probes)  # -> solution_par; plug-in component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
boolean_toggle_2 = BooleanToggle(False)
solution = Butterfly_Solution(
    case=snappyhexmesh.case,
    recipe=steadyincomp.recipe,
    decompose_par_dict=decomposepardict_scotch_2,
    solution_par=solutionparams_2,
    interval="4",
    write=boolean_toggle_2,
    run=boolean_toggle_2)  # -> out, solution, is_running, timestep, residual_fields, residual_values, log_files; plug-in component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
panel_9 = Panel(solution.solution)
loadprobesvalue = Butterfly_LoadProbesValue(solution=solution.solution, field="U")  # -> values; plug-in component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
flatten_tree_2 = FlattenTree(Tree=gentestpts.testPoints, Path="{0}")
pt = Point(flatten_tree_2)
vec = Vector(loadprobesvalue)
scale_2 = Slider(0.69, range=0..1)
panel_10 = Panel("wind simulation")
multiplication = Multiplication(A=vec, B=scale_2)

# ----
# have a check of the wind tunnel
loadmesh = Butterfly_LoadMesh(case=blockmesh.case, inner_mesh=False, load=Toggle(True))  # -> mesh; plug-in component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

loadprobesvalue_2 = Butterfly_LoadProbesValue(solution=solution.solution, field="U")  # -> values; plug-in component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
vector_length = VectorLength(Vector=loadprobesvalue_2)
larger_than = LargerThan(FirstNumber=vector_length, SecondNumber=Slider(2.2, range=0..10))  # -> LargerThan, OrEqualTo
dispatch = Dispatch(List=vector_length, DispatchPattern=larger_than.LargerThan)  # -> ListA, ListB
panel_11 = Panel(vector_length)
item_index = ItemIndex(List=vector_length, Item=dispatch.ListA)
replace_items = ReplaceItems(List=vector_length, Item=Slider(2.2, range=0..10), Indices=item_index, Wrap=False)

bnd = Bounds(Numbers=replace_items)
dedomain = DeconstructDomain(Domain=bnd)  # -> Start, End
gradient = Gradient(
    LowerLimit=dedomain.End,
    UpperLimit=dedomain.Start,
    Parameter=replace_items,
    stops=[0: RGB(234, 38, 0), 0.25: RGB(234, 126, 0), 0.5: RGB(254, 244, 84), 0.75: RGB(173, 203, 249), 1: RGB(75, 107, 169)])
vdisex = VectorDisplayEx(Point=pt, Vector=multiplication, Colour=gradient, Width=Slider(1, range=0..5))
